vi "index.gviweb"   [G Web Development Software 22.3.0]
panel controls:
  "Exit (development only)": bool
  "Test Start": bool
  "Test Sequence": T3[]
  "Cancel": bool
panel indicators:
  "Total Duration (s)": f64
  "Step Status": T1[]
  "ui": error
  "Program Log": string
  "dev status": string
  "Status": string
  "Initialized": bool
  "Finalized": bool
  "io": error
  "Graph": f64[][]
  "Result": bool
types:
  "Color.gtype" = u32
  T1 = cluster{"Progress": f64, "Result": "Color.gtype"}
  T2 = cluster{"Waveform": enum{"Constant", "Sawtooth", "Sinusoid"}, "Amplitude": f64, "Frequency": f64}
  T3 = cluster{"Duration (s)": f64, "Waveform Data": T2, "Fault Probability": f64}
  "Waveforms.gtype" = enum{"Constant", "Sawtooth", "Sinusoid"}
  "IO Data.gtype" = cluster{"Waveform": "Waveforms.gtype", "Duration (s)": f64, "Start Time": timestamp, "Time Factor": f64, "Adjusted Amplitude": f64, "New Wave": bool, "Wave Active": bool, "Fault start time": f64}
  "Step Result.gtype" = enum{"Pass", "Fail", "Canceled"}
  "Step Status.gtype" = cluster{"Progress": f64, "Result": "Step Result.gtype", "Complete": bool}
  "Waveform Data.gtype" = cluster{"Waveform": "Waveforms.gtype", "Amplitude": f64, "Frequency": f64}
  "Test Step Data.gtype" = cluster{"Duration (s)": f64, "Waveform Data": "Waveform Data.gtype", "Fault Probability": f64}
  "Manager State.gtype" = enum{"Idle", "Initialize", "Execute", "Finalize", "Cancel", "Error"}
  "Message Queue Names.gtype" = enum{"Manager", "UI", "IO"}
  "Step Data.gtype" = cluster{"Message Queue": "Message Queue Names.gtype", "Action": string}
  "Sequence.gtype" = cluster{"Manager State": "Manager State.gtype", "Steps": "Step Data.gtype"[]}
  "Manager Data.gtype" = cluster{"Current State": "Manager State.gtype", "Current Step": "Step Data.gtype", "Remaining Steps": "Step Data.gtype"[], "Remaining Sequences": "Sequence.gtype"[], "Current Instruction": string}
  "Error Data.gtype" = cluster{"Error Origin": "Message Queue Names.gtype", "Error In": error}
uses:
  WebApp::support::Message Queue::Create All Message Queues.gvi
  WebApp::support::Message Queue::Dequeue Message.gvi
  WebApp::globals.gviweb
  WebApp::Report Step Complete.gviweb
  WebApp::IO::Handle Next Waveform.gviweb
  WebApp::IO::Generate Waveform.gviweb
  WebApp::IO::Handle Hardware IO.gviweb
  WebApp::debug::Check Test Sequence Complete.gviweb
  NI::G Core::Error::Build Error Cluster.gvi
  WebApp::Handle Error.gviweb
  WebApp::Prep Step Staus for Display.gviweb
  WebApp::Calculate Test Duration.gviweb
  WebApp::Validate Test Sequence.gviweb
  WebApp::Handle Data Remaining in Queue.gviweb
  WebApp::Get Result Color.gviweb
  WebApp::Receive IO Data.gviweb
  WebApp::support::Message Queue::Enqueue Message (Single).gvi
  WebApp::UI messages::Append Log Text.gviweb
  WebApp::program sequences::Handle Next Sequence.gviweb
  WebApp::program sequences::Handle Next Step.gviweb
  WebApp::UI messages::Send Sequence Complete UI Updates.gviweb
  WebApp::UI messages::Update Program Status.gviweb
  WebApp::support::Error Handler - Event Handling Loop.gvi
diagram:
  # #debug
  Property Node(instance in=reference to "dev status", "Value"="") -> (error out=w1)
  w2 = bool FALSE  # Stop Event
  Create User Event[EventName="Stop Event"](error in=w1, user event data type=w2) -> (error out=w3, user event out=w4)
  Obtain Queue(element data type=f64[] [], name="output data") -> (queue out=w5)
  # Idle
  #
  # Start Pressed
  #
  # Initializaing
  # 	>> To IO ---Initialize
  # 	Waiting on UI
  # 	>> To UI ---Initialize
  # 	Waiting on IO
  # Executing
  # 	>> To IO ---Execute
  # 	Waiting on IO
  # Finalizing
  # 	>> To IO ---Finalize
  # 	Waiting on IO
  # 	>> To UI ---Finalize
  # 	Waiting on UI
  # Completed
  Build Array("Manager", "UI", "IO") -> w6
  Array Size(array=w6) -> (size(s)=w7)
  call "Create All Message Queues.gvi"(Loop Count=w7, error in=w3) -> (Message Queues=w8, error out=w9)
  Array Index(array=w8) -> (out0[_]=w10, out1[_]=w11, out2[_]=w12)
  s1 = uninitialised  # shift register
  s2 = uninitialised  # shift register
  while {
    call "Dequeue Message.gvi"(message queue in=w12, timeout in milliseconds=0, error in=w9) -> (timed out?=w13, message queue out=w14, message=w15, message data=w16, error out=w17)
    # UI Update Loop
    case (w15) ignore case {  # Message Cases
      frame "SW Init" {
        Property Node(instance in=reference to "io", "Value"=no error, error in=w17) -> (error out=w18)
        w19 = default
        w20 = s1
        w21 = "IO Data.gtype" {all zero or empty}
      }
      frame "Initialize" {
        disable {
          frame Disabled {
            # #Integrate_Hardware
            # Hardware uninitialization goes here
            w22 = w17
          }
          frame Enabled {
            call "globals.gviweb"() -> (Globals=w23)
            Property Node(instance in=w23) -> ("Hardware Initialize Duration (s)"=w24)
            # #debug
            Multiply(w24, 1000) -> w25
            Wait(time to wait=w25)
            w22 = w17
          }
        }
        call "Report Step Complete.gviweb"(Manager Queue=w10, This Queue Name="IO", Step Name=w15, Input_3=w22) -> (Output_2=w18)
        w19 = default
        w20 = s1
        w21 = s2
      }
      frame "Finalize" {
        disable {
          frame Disabled {
            # #Integrate_Hardware
            # Hardware uninitialization goes here
            w26 = w17
          }
          frame Enabled {
            call "globals.gviweb"() -> (Globals=w27)
            Property Node(instance in=w27) -> ("Hardware Finalize Duration (s)"=w28)
            # #debug
            Multiply(w28, 1000) -> w29
            Wait(time to wait=w29)
            w26 = w17
          }
        }
        call "Report Step Complete.gviweb"(Manager Queue=w10, This Queue Name="IO", Step Name=w15, Input_3=w26) -> (Output_2=w18)
        w19 = default
        w20 = s1
        w21 = s2
      }
      frame "Execute" {
        # #todo move some of this functionality to initialization and check if test sequence is empty
        # report empty back to manager
        call "Handle Next Waveform.gviweb"(Test Sequence in=$"Test Sequence", IO Data In=s2) -> (Test Sequence out=w20, IO Data out=w21)
        w18 = w17
        w19 = default
      }
      frame "Cancel" {
        sequence {
          frame 0 {
            # Stop IO
            Property Node(instance in=s2, "Wave Active"=FALSE) -> (instance out=w21)
          }
        }
        call "Report Step Complete.gviweb"(Manager Queue=w10, This Queue Name="IO", Step Name=w15, Input_3=w17) -> (Output_2=w18)
        w19 = default
        w20 = s1
      }
      frame "Error" {
        Variant To Data(error in (no error)=w17, type=no error, variant=w16) -> (data=w30, error out=w18)
        # #CodeRecommended - If you ever change the name of this "Error" message, you'll need to update the name in the Check Loop Error.vi as well.
        $io <- w30
        w19 = default
        w20 = s1
        w21 = s2
      }
      frame "---Copy This Frame---" {
        Merge Errors(w17) -> (error out=w18)
        w19 = default
        w20 = s1
        w21 = s2
      }
      frame "Exit" {
        Release Queue(queue=w14) -> (error out=w31)
        Merge Errors(w17, w31) -> (error out=w18)
        w19 = TRUE
        w20 = s1
        w21 = s2
      }
      frame Default {
        case (w13) {
          frame True {
            Property Node(instance in=s2) -> ("Wave Active"=w32, instance out=w33)
            # No message -> handle output
            case (w32) {
              frame False, Default {
                w21 = w33
                w18 = w17
                w20 = s1
              }
              frame True {
                Property Node(instance in=w33) -> ("New Wave"=w34, instance out=w35)
                case (w34) {
                  frame False, Default {
                    w36 = w35
                  }
                  frame True {
                    Get Current Time() -> (current time=w37)
                    # only save init timestamp at wave start
                    Property Node(instance in=w35, "Start Time"=w37, "New Wave"=FALSE) -> (instance out=w36)
                  }
                }
                call "Generate Waveform.gviweb"(IO Data=w36) -> (Time Elapsed=w38, IO data out=w39, Wave Value=w40, Fraction Complete=w41)
                call "Handle Hardware IO.gviweb"(IO data in=w39, Hardware output=w40, Time Elapsed=w38) -> (IO data out=w42, Hardware input=w43)
                call "Check Test Sequence Complete.gviweb"(This Queue Name="IO", Test Sequence in=s1, IO data in=w42, Fraction Complete=w41, Manager Queue=w10) -> (Test Sequence out=w20, IO data out=w21, Fraction Complete (includes messages)=w44)
                Build Array(w44, w40, w43) -> w45
                Enqueue Element(element=w45, error in=w17, queue=w5) -> (error out=w18)
              }
            }
          }
          frame False {
            # Received message
            w46 = "The invalid message string \"%s\" was received in the Message Handling Loop."
            Format Into String(formatString=w46, w15) -> w47
            call "Build Error Cluster.gvi"(code=1, description=w47, error in=w17) -> (error out=w18)
            w21 = s2
            w20 = s1
          }
        }
        w19 = default
      }
    }
    call "Handle Error.gviweb"(Input=w10, Input_2="IO", Output_2=w18) -> (Output_3=w48)
    Wait(time to wait=50)
    next s1 = w20
    next s2 = w21
    stop if w19
  }
  s3 = uninitialised  # shift register
  s4 = uninitialised  # shift register
  s5 = uninitialised  # shift register
  s6 = uninitialised  # shift register
  s7 = uninitialised  # shift register
  s8 = uninitialised  # shift register
  while {
    call "Dequeue Message.gvi"(message queue in=w11, timeout in milliseconds=s4, error in=w9) -> (timed out?=w49, message queue out=w50, message=w51, message data=w52, error out=w53)
    # UI Update Loop
    # s8: Step Index
    # s7: Test Steps
    # s4: Dequeue Timeout
    case (w51) ignore case {  # Message Cases
      frame "SW Init" {
        Property Node(instance in=reference to "Result", "Value"=FALSE, "Text"=[" ", " "])
        Property Node(instance in=reference to "Initialized", "Value"=FALSE)
        Property Node(instance in=reference to "Finalized", "Value"=FALSE)
        Property Node(instance in=reference to "Finalized", "Value"=FALSE)
        Property Node(instance in=reference to "Test Sequence", "Disabled"=FALSE)
        Property Node(instance in=reference to "ui", "Value"=no error, error in=w53) -> (error out=w62, instance out=w63)
        Property Node(instance in=reference to "Initialized", "Value"=FALSE, error in=w53) -> (error out=w64, instance out=w65)
        Property Node(instance in=reference to "Status", "Value"="Idle", error in=w53) -> (error out=w66, instance out=w67)
        Property Node(instance in=reference to "Program Log", "Value"="", error in=w53) -> (error out=w68, instance out=w69)
        Build Array(w63, w65, w67, w69) -> w70
        Merge Errors(w62, w64, w66, w68) -> (error out=w71)
        s9 = w71  # shift register
        for {
          w72 = each element of w70
          Close Reference(error in=s9, reference=w72) -> (error out=w73)
          next s9 = w73
        }
        Array Size(array=[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]) -> (size(s)=w60)
        Initialize Array(element="Step Status.gtype" {all zero or empty}, size=w60) -> w59
        call "Prep Step Staus for Display.gviweb"(Steps status out=w59) -> (Step Status=w74)
        Property Node(instance in=reference to "Step Status", "Value"=w74)
        call "Calculate Test Duration.gviweb"(Test Sequences=[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]) -> (Total Duration (s)=w75)
        Property Node(instance in=reference to "Total Duration (s)", "Value"=w75)
        w54 = s9
        w55 = default
        w56 = ""
        w57 = -1
        w58 = f64[][] []
        w61 = 0
      }
      frame "Handle Test Change" {
        Variant To Data(error in (no error)=w53, type="Test Step Data.gtype"[] [], variant=w52) -> (data=w76, error out=w77)
        Array Size(array=w76) -> (size(s)=w60)
        call "Calculate Test Duration.gviweb"(Test Sequences=w76) -> (Total Duration (s)=w78)
        $"Total Duration (s)" <- w78
        call "Validate Test Sequence.gviweb"(Input=reference to "Test Sequence", UI Queue=w50, data=w76, error in=w77) -> (Error out=w54)
        w55 = default
        w56 = s3
        w57 = s4
        w58 = s5
        w59 = s6
        w61 = s8
      }
      frame "Execute" {
        # start polling to process data from IO loop
        call "Report Step Complete.gviweb"(Manager Queue=w10, This Queue Name="UI", Step Name=w51, Input_3=w53) -> (Output_2=w54)
        w55 = default
        w56 = s3
        w57 = 0
        w58 = s5
        w59 = s6
        w60 = s7
        w61 = s8
      }
      frame "Update Status" {
        Variant To Data(error in (no error)=w53, type=string "", variant=w52) -> (data=w79, error out=w54)
        Format Into String(formatString="%s\n%s", s3, w79) -> w56
        $"Program Log" <- w56
        w55 = default
        w57 = s4
        w58 = s5
        w59 = s6
        w60 = s7
        w61 = s8
      }
      frame "Update Program Status" {
        Variant To Data(error in (no error)=w53, type=w51, variant=w52) -> (data=w80, error out=w54)
        $Status <- w80
        w55 = default
        w56 = s3
        w57 = s4
        w58 = s5
        w59 = s6
        w60 = s7
        w61 = s8
      }
      frame "Initialize Complete" {
        $Initialized <- TRUE
        w54 = w53
        w55 = default
        w56 = s3
        w57 = s4
        w58 = s5
        w59 = s6
        w60 = s7
        w61 = s8
      }
      frame "Initialize" {
        Property Node(instance in=reference to "Result", "Value"=FALSE)
        Property Node(instance in=reference to "Test Sequence", "Disabled"=TRUE)
        Property Node(instance in=reference to "Initialized", "Value"=FALSE)
        Property Node(instance in=reference to "Finalized", "Value"=FALSE)
        # Enure at least 1 step is present
        Max And Min(x=s7, y=1) -> (max(x,y)=w81: i32)
        Initialize Array(element="Step Status.gtype" {all zero or empty}, size=w81) -> w59
        call "Prep Step Staus for Display.gviweb"(Steps status out=w59) -> (Step Status=w82)
        Property Node(instance in=reference to "Step Status", "Value"=w82, error in=w53) -> (error out=w83)
        call "Report Step Complete.gviweb"(Manager Queue=w10, This Queue Name="UI", Step Name=w51, Input_3=w83) -> (Output_2=w54)
        w55 = default
        w56 = s3
        w57 = s4
        w58 = f64[][] []
        w60 = s7
        w61 = 0
      }
      frame "Execute Complete" {
        # Handle any data remaining in queue
        call "Handle Data Remaining in Queue.gviweb"(Input_3=reference to "Graph", Input_2=reference to "Step Status", Input_4=w5, Input_5=s8, Input=s5, Input_6=s6, Input_7=w53) -> (Output=w61, Output_3=w58, Output_4=w59, Output_2=w54)
        w55 = default
        w56 = s3
        w57 = s4
        w60 = s7
      }
      frame "Finalize" {
        s10 = "Pass"  # shift register
        for {
          w84 = each element of s6
          Property Node(instance in=w84) -> ("Result"=w85)
          case (s10) {
            frame "Pass", Default {
              w86 = w85
            }
            frame "Fail" {
              case (w85) {
                frame Default {
                  w86 = w85
                }
                frame "Pass" {
                  w86 = s10
                }
              }
            }
            frame "Canceled" {
              w86 = "Canceled"
            }
          }
          next s10 = w86
        }
        call "Get Result Color.gviweb"(Input=s10) -> (Output=w87)
        Format Into String(formatString="%s", s10) -> w88
        Build Array(w88) -> w89
        # stop polling
        Property Node(instance in=reference to "Result", "TrueColor"=w87, "Text"=w89)
        $Result <- TRUE
        Property Node(instance in=reference to "Test Sequence", "Disabled"=TRUE)
        call "Report Step Complete.gviweb"(Manager Queue=w10, This Queue Name="UI", Step Name=w51, Input_3=w53) -> (Output_2=w54)
        w55 = default
        w56 = s3
        w57 = -1
        w58 = s5
        w59 = s6
        w60 = s7
        w61 = s8
      }
      frame "Finalize Complete" {
        $Finalized <- TRUE
        Property Node(instance in=reference to "Test Sequence", "Disabled"=FALSE)
        w54 = w53
        w55 = default
        w56 = s3
        w57 = s4
        w58 = s5
        w59 = s6
        w60 = s7
        w61 = s8
      }
      frame "Cancel" {
        Array Index(array=s6) -> (out0[s8]=w90)
        Property Node(instance in=w90, "Result"="Canceled") -> (instance out=w91)
        Replace Array Subset(inArray=s6, index=s8, new=w91) -> w92
        call "Handle Data Remaining in Queue.gviweb"(Input_3=reference to "Graph", Input_2=reference to "Step Status", Input_4=w5, Input_5=s8, Input=s5, Input_6=w92, Input_7=w53) -> (Output=w61, Output_3=w58, Output_4=w59, Output_2=w93)
        call "Report Step Complete.gviweb"(Manager Queue=w10, This Queue Name="UI", Step Name=w51, Input_3=w93) -> (Output_2=w54)
        w55 = default
        w56 = s3
        w57 = s4
        w60 = s7
      }
      frame "Cancel Complete" {
        w54 = w53
        w55 = default
        w56 = s3
        w57 = s4
        w58 = s5
        w59 = s6
        w60 = s7
        w61 = s8
      }
      frame "Error" {
        Variant To Data(error in (no error)=w53, type=no error, variant=w52) -> (data=w94, error out=w54)
        # #CodeRecommended - If you ever change the name of this "Error" message, you'll need to update the name in the Check Loop Error.vi as well.
        $ui <- w94
        w55 = default
        w56 = s3
        w57 = s4
        w58 = s5
        w59 = s6
        w60 = s7
        w61 = s8
      }
      frame "---Copy This Frame---" {
        Merge Errors(w53) -> (error out=w54)
        w55 = default
        w56 = s3
        w57 = s4
        w58 = s5
        w59 = s6
        w60 = s7
        w61 = s8
      }
      frame "Exit" {
        Release Queue(queue=w50) -> (error out=w95)
        Release Queue(queue=w5) -> (error out=w96)
        Merge Errors(w53, w95, w96) -> (error out=w54)
        w55 = TRUE
        w56 = s3
        w57 = s4
        w58 = s5
        w59 = s6
        w60 = s7
        w61 = s8
      }
      frame Default {
        case (w49) {
          frame True {
            Wait(time to wait=500)
            call "Receive IO Data.gviweb"(Test data in=s5, Steps status in=s6, Step Index in=s8, error in=w53, IO Data Queue=w5) -> (Test data out=w58, Steps status out=w59, Step Index out=w61, error out=w54, Test Data for Graph=w97)
            $Graph <- w97
            call "Prep Step Staus for Display.gviweb"(Steps status out=w59) -> (Step Status=w98)
            $"Step Status" <- w98
          }
          frame False {
            w99 = "The invalid message string \"%s\" was received in the Message Handling Loop."
            Format Into String(formatString=w99, w51) -> w100
            call "Build Error Cluster.gvi"(code=1, description=w100, error in=w53) -> (error out=w54)
            w58 = s5
            w59 = s6
            w61 = s8
          }
        }
        w55 = default
        w56 = s3
        w57 = s4
        w60 = s7
      }
    }
    call "Handle Error.gviweb"(Input=w10, Input_2="UI", Output_2=w54) -> (Output_3=w101)
    next s3 = w56
    next s4 = w57
    next s5 = w58
    next s6 = w59
    next s7 = w60
    next s8 = w61
    stop if w55
  }
  # Make list of messages for easy screening
  w102 = [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]  # Instructions
  for {
    w103 = each element of w102
    Property Node(instance in=w103) -> ("Init Info:Instruction"=w105)
    append w105 to w104
  }
  s11 = uninitialised  # shift register
  while {
    call "Dequeue Message.gvi"(message queue in=w10, error in=w9) -> (message queue out=w106, message=w107, message data=w108, error out=w109)
    # Manager Loop
    # w4: Stop Event
    case (w107) ignore case {  # Message Cases
      frame "SW Init" {
        w110 = w109
        w111 = default
        w112 = "Manager Data.gtype" {all zero or empty}
      }
      frame "Test Sequence Change" {
        Array Index(array=w8) -> (out0["UI"]=w113)
        call "Enqueue Message (Single).gvi"(message queue in=w113, message="Handle Test Change", message data=w108, error in=w109) -> (error out=w110)
        w111 = default
        w112 = s11
      }
      frame "Error" {
        Variant To Data(error in (no error)=w109, type="Error Data.gtype" {all zero or empty}, variant=w108) -> (data=w114, error out=w115)
        Property Node(instance in=w114) -> ("Error Origin"=w116, "Error In"=w117)
        Property Node(instance in=w117) -> ("code"=w118, "source"=w119)
        w120 = "================\nError\n\nAt: %s\n\nCode: %d\n%s\n================"
        Format Into String(formatString=w120, errIn=w115, w116, w118, w119) -> (outString=w121, errOut=w122)
        call "Append Log Text.gviweb"(Input=w8, resulting string=w121, error out=w122) -> (Output_2=w110)
        w111 = default
        w112 = s11
      }
      frame "Exit Pressed" {
        # #development
        s12 = w109  # shift register
        for {
          w123 = each element of w8
          call "Enqueue Message (Single).gvi"(message queue in=w123, message="Exit", error in=s12) -> (error out=w124)
          next s12 = w124
        }
        Merge Errors(s12) -> (error out=w110)
        w111 = default
        w112 = s11
      }
      frame "Exit" {
        Generate User Event(event data=TRUE, user event=w4) -> (error out=w125)
        Release Queue(queue=w106) -> (error out=w126)
        Merge Errors(w126, w125) -> (error out=w110)
        w111 = TRUE
        w112 = s11
      }
      frame Default {
        w127 = "The invalid message string \"%s\" was received in the Message Handling Loop."
        # Message undefined
        Format Into String(formatString=w127, w107) -> w128
        call "Build Error Cluster.gvi"(code=1, description=w128, error in=w109) -> (error out=w110)
        w111 = default
        w112 = s11
      }
      frame "Instruction" {
        Variant To Data(error in (no error)=w109, type=w107, variant=w108) -> (data=w129, error out=w130)
        Search 1D Array(1D array=w104, element=w129) -> (index of element=w131)
        case (w131) {
          frame Default {
            # Message in sequence start list -> ensure in valid start state
            Property Node(instance in=s11) -> ("Current State"=w132, instance out=w133)
            Array Index(array=w102) -> (out0[w131]=w134)
            Property Node(instance in=w134) -> ("Init Info:Valid Starts"=w135, instance out=w136)
            Search 1D Array(1D array=w135, element=w132) -> (index of element=w137)
            case (w137) {
              frame Default {
                Format Into String(formatString="******************\nStart: %s\n******************", errIn=w130, w129) -> (outString=w138, errOut=w139)
                call "Append Log Text.gviweb"(Input=w8, resulting string=w138, error out=w139) -> (Output_2=w140)
                Property Node(instance in=w136) -> ("Sequences"=w141)
                # In valid state for recieved message -> react
                call "Handle Next Sequence.gviweb"(manager data in=w133, Sequences=w141, error in=w140, Message Queues=w8) -> (manager data out=w142, Sequence Steps=w143, End Instruction=w144, error out=w145)
                case (w144) {
                  frame True {
                    w146 = "-------------------------------------\nInstruction Sequences Empty\n-------------------------------------"
                    # #verify
                    call "Append Log Text.gviweb"(Input=w8, resulting string=w146, error out=w145) -> (Output_2=w110)
                    w112 = w142
                  }
                  frame False {
                    Property Node(instance in=w142, "Current Instruction"=w129) -> (instance out=w147)
                    call "Handle Next Step.gviweb"(message queues=w8, manager data in=w147, Sequence Steps=w143, Input=w145) -> (manager data out=w112, Output=w110)
                  }
                }
              }
              frame -1 {
                w148 = """-------------------------------------
Received inavalid message for current status

Invalid Message: %s

State: %s
Currently waiting on: %s
-------------------------------------"""
                Property Node(instance in=w133) -> ("Current State"=w149, "Current Step:Message Queue"=w150)
                Format Into String(formatString=w148, errIn=w130, w129, w149, w150) -> (outString=w151, errOut=w152)
                call "Append Log Text.gviweb"(Input=w8, resulting string=w151, error out=w152) -> (Output_2=w110)
                w112 = w133
              }
            }
          }
          frame -1 {
            # Instruction name missing from list
            # Message undefined
            Format Into String(formatString="Instruction \"%s\" undefined.", w107) -> w153
            call "Build Error Cluster.gvi"(code=1, description=w153, error in=w130) -> (error out=w110)
            w112 = s11
          }
        }
        w111 = default
      }
      frame "Step Complete" {
        Property Node(instance in=s11) -> ("Current Step"=w154)
        Variant To Data(error in (no error)=w109, type=w154, variant=w108) -> (data=w155, error out=w156)
        Is Equal[ComparisonMode=CompareAggregates](x=w154, y=w155) -> w157
        case (w157) {
          frame False, Default {
            w110 = w156
            w112 = s11
          }
          frame True {
            Property Node(instance in=s11) -> ("Remaining Steps"=w158, instance out=w159)
            Array Size(array=w158) -> (size(s)=w160)
            Property Node(instance in=w154) -> ("Message Queue"=w161, "Action"=w162)
            Format Into String(formatString="Completed %s %s", errIn=w156, w161, w162) -> (outString=w163, errOut=w164)
            call "Append Log Text.gviweb"(Input=w8, resulting string=w163, error out=w164) -> (Output_2=w165)
            case (w160) {
              frame Default {
                call "Handle Next Step.gviweb"(message queues=w8, manager data in=w159, Sequence Steps=w158, Input=w165) -> (manager data out=w112, Output=w110)
              }
              frame 0 {
                Property Node(instance in=w159) -> ("Remaining Sequences"=w166, "Current State"=w167, instance out=w168)
                call "Send Sequence Complete UI Updates.gviweb"(Current State=w167, Input=w8, Error In=w165) -> (Error out=w169)
                call "Handle Next Sequence.gviweb"(manager data in=w168, Sequences=w166, error in=w169, Message Queues=w8) -> (manager data out=w170, Sequence Steps=w171, End Instruction=w172, error out=w173)
                Property Node(instance in=w170) -> ("Current State"=w174, instance out=w175)
                Format Into String(formatString="%s", errIn=w173, w174) -> (outString=w176, errOut=w177)
                case (w172) {
                  frame False, Default {
                    call "Update Program Status.gviweb"(resulting string=w176, Message Queues=w8) -> (error out=w178)
                    call "Handle Next Step.gviweb"(message queues=w8, manager data in=w175, Sequence Steps=w171, Input=w178) -> (manager data out=w112, Output=w110)
                  }
                  frame True {
                    call "Update Program Status.gviweb"(resulting string=w176, Message Queues=w8, Input=w177) -> (error out=w179)
                    # Instruction complete
                    Property Node(instance in=w175) -> ("Current Instruction"=w180, instance out=w112)
                    Format Into String(formatString="******************\nComplete: %s\n******************", w180) -> w181
                    call "Append Log Text.gviweb"(Input=w8, resulting string=w181, error out=w179) -> (Output_2=w110)
                  }
                }
              }
            }
          }
        }
        w111 = default
      }
    }
    call "Handle Error.gviweb"(Input=w106, Input_2="Manager", Output_2=w110) -> (Output_3=w182)
    next s11 = w112
    stop if w111
  }
  # #todo
  # error handling - display in status log
  # error fault sim
  # be able to clear error with corresponding case in IO
  #
  # create/ configure simulation cases/ flags
  # clean up
  # 	save all text log messages in same place
  # handle error from hardware during initialize or execute
  # 	be able to clear error
  #
  #
  #
  # #additional functionality
  # ---------------------------------
  # add finalize commands
  # 	log data
  # 		with test meta data/ description
  # 	log results
  # cancel
  # abort
  # hardware fault button
  # 	just poll in UI loop?
  # -------------------------------------------------------
  # abort
  # Display test history/ data
  # Pause
  # select between historical data
  # historical analysis/ comparison
  # Splining/ smooth transitions between waveforms
  # unit tests
  # check for empty test sequence
  # force sawtooth to return to 0 before waveform transition?
  # unit tests
  Register For Events("Stop Event"=w4) -> (event registration refnum out=w183)
  s13 = w183  # shift register
  while {
    event (dynamic events = s13) {
      on "Test Start" Value changed {
        # #CodeNeeded - Send the appropriate message for this user interface event.
        call "Enqueue Message (Single).gvi"(message queue in=w10, message="Instruction", message data="Run Test Sequence") -> (message queue out=w186, error out=w185)
        w184 = default
      }
      on "Cancel" Value changed {
        # #CodeNeeded - Send the appropriate message for this user interface event.
        call "Enqueue Message (Single).gvi"(message queue in=w10, message="Instruction", message data="Cancel") -> (message queue out=w186, error out=w185)
        w184 = default
      }
      on "Exit (development only)" Value changed {
        call "Enqueue Message (Single).gvi"(priority message=TRUE, message queue in=w10, message="Exit Pressed") -> (message queue out=w186, error out=w185)
        w184 = default
      }
      on dynamic event 0 {
        # The Message Handling Loop processed an "Exit" message, which fired this event to stop the Event Handling Loop.
        w184 = TRUE
        w185 = default
        w186 = w10
      }
      on "Test Sequence" Value changed {
        Event Data() -> ("New Value"=w187)
        To Variant(anything=w187) -> w188
        call "Enqueue Message (Single).gvi"(message queue in=w10, message="Test Sequence Change", message data=w188) -> (message queue out=w186, error out=w185)
        w184 = default
      }
    }
    call "Error Handler - Event Handling Loop.gvi"(message queue in=w186, error in=w185) -> (dup error in=w189)
    stop if w184
  }
  Unregister For Events(error in=w189, event registration refnum=s13) -> (error out=w190)
  Merge Errors(w190, w182, w101, w48) -> (error out=w191)
  Destroy User Event(error in=w191, user event=w4)
  Property Node(instance in=reference to "Test Sequence", "Value"=[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])
